% Simulink data dictionary prdLuxuryCar_dict.sldd

LightSensorIfc = Simulink.ServiceBus()
  read: y = read(), Asynchronous=false, Arguments=Simulink.BusElement(Name="y", DataType="double")

DcMotorIfc = Simulink.ServiceBus()
  moveTo: moveTo(position), Asynchronous=false, Arguments=Simulink.BusElement(Name="position", DataType="double")
  isBusy: y = isBusy(), Asynchronous=false, Arguments=Simulink.BusElement(Name="y", DataType="double")

WiperCtrlRequest = Simulink.ServiceBus()
  getMode: y = getMode(), Asynchronous=false, Arguments=Simulink.BusElement(Name="y", DataType="double")